vi "sub_apply filter.gvi"   [LabVIEW NXG 5.0.0]
inputs:
  "input complex waveform": cluster{"t0": f64, "dt": f64, "Y": c128[]}
  "filter coefficients": c128[]
  "error in": error
  "reset?": bool = TRUE
outputs:
  "output complex waveform": cluster{"t0": f64, "dt": f64, "Y": c128[]}
  "error out": error
types:
  T1 = cluster{"filter structure": i32, "forward coefficients": f64[], "reverse coefficients": f64[], "sampling frequency": f64}
uses:
  NI::Analysis::Filtering::Filtering (DBL).gvi
diagram:
  case ($"error in") {
    frame No Error {
      Is First Call() -> w3
      Logical Or(w3, $"reset?") -> w4
      Property Node(instance in=$"input complex waveform") -> ("Y"=w5)
      Complex To Real And Imaginary(x + iy=w5) -> (x=w6, y=w7)
      Complex To Real And Imaginary(x + iy=$"filter coefficients") -> (x=w8, y=w9)
      w10 = T1 {"filter structure"=3, "forward coefficients"=[], "reverse coefficients"=[], "sampling frequency"=1}
      Property Node(instance in=w10, "forward coefficients"=w8) -> (instance out=w11)
      call "Filtering (DBL).gvi"(signal=w6, filter=w11, error in=$"error in", reset=w4) -> (filtered signal=w12, error out=w13)
      w14 = T1 {"filter structure"=3, "forward coefficients"=[], "reverse coefficients"=[], "sampling frequency"=1}
      Property Node(instance in=w14, "forward coefficients"=w9) -> (instance out=w15)
      call "Filtering (DBL).gvi"(signal=w7, filter=w15, reset=w4) -> (filtered signal=w16, error out=w17)
      Subtract(x=w12, y=w16) -> w18
      call "Filtering (DBL).gvi"(signal=w6, filter=w15, reset=w4) -> (filtered signal=w19, error out=w20)
      call "Filtering (DBL).gvi"(signal=w7, filter=w11, error in=$"error in", reset=w4) -> (filtered signal=w21, error out=w22)
      Add(w19, w21) -> w23
      Real And Imaginary To Complex(x=w18, y=w23) -> w24
      Property Node(instance in=$"input complex waveform", "Y"=w24) -> (instance out=w1)
      Merge Errors(w13, w17, w20, w22) -> (error out=w2)
      Subtract(x=w6, y=w8)
    }
    frame Error {
      w1 = default
      w2 = $"error in"
    }
  }
  $"output complex waveform" <- w1
  $"error out" <- w2
