vi "SUB_LMS-based equalizer.gvi"   [LabVIEW NXG 5.0.0]
inputs:
  "input complex waveform": cluster{"t0": f64, "dt": f64, "Y": c128[]} = {"t0"=0, "dt"=1, "Y"=[]}
  "error in": error
  "QAM system parameters": T1 = {"samples per symbol (16)"=16, "symbol map"=[]}
  "reset?": bool = TRUE
  "equalizer length": i32 = 1
  "training bits": i8[]
  "feedforward equalizer (lms) parameters": T2 = {"taps per symbol"=1, "delta (training)"=0.01, "delta (steady state)"=0.01}
outputs:
  "error out": error
  "output complex waveform": cluster{"t0": f64, "dt": f64, "Y": c128[]}
  "output bit stream": i8[]
types:
  T1 = cluster{"samples per symbol (16)": i32, "symbol map": c128[]}
  T2 = cluster{"taps per symbol": i32, "delta (training)": f64, "delta (steady state)": f64}
diagram:
  case ($"error in") {
    frame No Error {
      Property Node(instance in=$"QAM system parameters") -> ("symbol map"=w4)
      call "sub_Valid.gvi"(input complex waveform=$"input complex waveform", qam system parameters=$"QAM system parameters", feedforward equalizer (lms) parameters=$"feedforward equalizer (lms) parameters", equalizer length=$"equalizer length", equalizer specification="Specify length") -> (error out=w5)
      call "sub_M-QAM mapper.gvi"(reset?=TRUE, input bit stream=$"training bits", error in=w5, symbol map=w4) -> (symbols=w6, error out=w7)
      Is First Call() -> w8
      Logical Or($"reset?", w8) -> w9
      call "sub_algorithm_1.gvi"(reset?=w9, equalizer taps=$"equalizer length", input complex waveform=$"input complex waveform", qam system parameters=$"QAM system parameters", feedforward equalizer (lms) parameters=$"feedforward equalizer (lms) parameters", training symbols=w6, error in=w7, equalizer specification="Specify length") -> (output complex waveform=w2, equalized symbols=w10, error out=w11)
      call "sub_M-QAM demapper.gvi"(symbols in=w10, error in=w11, symbol map=w4) -> (bits out=w3, error out=w12)
      call "sub_error_clustering.gvi"(final error in=w12, initial error in=$"error in") -> (error out=w1)
    }
    frame Error {
      w1 = $"error in"
      w2 = default
      w3 = default
    }
  }
  $"output complex waveform" <- w2
  $"output bit stream" <- w3
  $"error out" <- w1
