vi "sub_Convert bit to array.gvi"   [LabVIEW NXG 5.0.0]
inputs:
  "가드 비트": i32
  "싱크 비트 입력": i32
  "출력 비트 스트림": i8[]
  "논리적 AND": bool
  "에러": error
outputs:
  "입력": i8[]
  "싱크 비트": i8[]
  "에러 출력": error
uses:
  NI::Modulation::MT Generate Bits (User Defined).gvi
  NI::Modulation::MT Generate Bits (Galois, PN Order).gvi
diagram:
  s1 = uninitialised  # shift register
  s2 = uninitialised  # shift register
  while {
    case ($"논리적 AND") {
      frame False, Default {
        w1 = $"출력 비트 스트림"
        w2 = $"에러"
        w3 = s1
        w4 = s2
      }
      frame True {
        call "MT Generate Bits (User Defined).gvi"(reset?=TRUE, total bits=$"가드 비트", error in=$"에러", user base bit pattern=[1]) -> (output bit stream=w4, error out=w5)
        call "MT Generate Bits (Galois, PN Order).gvi"(reset?=TRUE, total bits=$"싱크 비트 입력", PN sequence order=21, error in=w5) -> (output bit stream=w3, error out=w2)
        Build Array(w4, w3, $"출력 비트 스트림") -> w1
      }
    }
    next s1 = w3
    next s2 = w4
    continue if FALSE
  }
  $"싱크 비트" <- s1
  $"입력" <- w1
  $"에러 출력" <- w2
