vi "sub_FIFO of bit.gvi"   [LabVIEW NXG 5.0.0]
inputs:
  "블록 길이 (-1)": i32 = -1
  "입력": i8[]
  "논리적 OR": bool
outputs:
  "배열": i8[]
  "입력 스트림": i8[]
diagram:
  s1 = uninitialised  # shift register
  while {
    Build Array(s1, $"입력") -> w1
    Select(s=$"논리적 OR", t=$"입력", f=w1) -> w2
    Is Less Than 0(x=$"블록 길이 (-1)") -> w3
    Array Size(array=w2) -> (size(s)=w4)
    Is Less Or Equal(x=w4, y=$"블록 길이 (-1)") -> w5
    Logical Or(w5, w3) -> w6
    case (w6) {
      frame False, Default {
        Split 1D Array(array=w2, index=$"블록 길이 (-1)") -> (first subarray=w8, second subarray=w7)
      }
      frame True {
        # No remaining Bits
        w7 = i8[] []
        w8 = w2
      }
    }
    next s1 = w7
    continue if FALSE
  }
  $"입력 스트림" <- w8
  $"배열" <- s1
