vi "sub_error_clustering.gvi"   [LabVIEW NXG 5.0.0]
inputs:
  "final error in": error
  "initial error in": error
outputs:
  "error out": error
diagram:
  Property Node(instance in=$"final error in") -> ("code"=w1)
  Is Equal To 0(x=w1) -> w2
  Property Node(instance in=$"initial error in") -> ("code"=w3)
  Is Equal(x=w1, y=w3) -> w4
  Logical Or(w2, w4) -> w5
  case (w5) {
    frame True {
      w6 = $"initial error in"
    }
    frame False {
      Call Chain() -> (callchain=w7)
      Array Subset(array=w7, index0=1) -> w8
      Reverse 1D Array(array=w8) -> (reversed array=w9)
      Array To Spreadsheet String(array=w9, delimiter=" -> ", format string="%s") -> (spreadsheet string=w10)
      Property Node(instance in=$"final error in", "source"=w10) -> (instance out=w11)
      Merge Errors($"initial error in", w11) -> (error out=w6)
    }
  }
  $"error out" <- w6
