vi "Main_LMS algorithm-based adaptive equalizer.gvi"   [LabVIEW NXG 5.0.0]
# This examples demonstrates the effects of noise and impairments in a QAM Modulation Demodulation System
panel controls:
  "정지": bool
  "System Filter": T3 = {"TX Filter"="Raised Cosine", "Alpha"=0.2, "filter length"=4}
  "System parameters": T4 = {"M-QAM"="128", "Guard Symbols"=32, "Message Symbols"=10000, "Samples per Symbol"=8, "Sync Symbols"=16, "PN sequence order"=21, "Symbol Rate [Hz]"=500000}
  "Channel option": T5 = {"AWGN"=TRUE, "Phase Noise"=FALSE, "IQ Impairments"=TRUE, "LMS"=TRUE}
  "Minimum boundary [Eb/N0]": f64 = 14.9157303371
  "Maximum boundary [Eb/N0]": f64 = 24.6535580524
  "탭": i32 = 1
panel indicators:
  "LMS-based adaptive equalizer": T1[]
  "System filter only applied": T1[]
  "Comparison and analysis of MER [dB]": f64[][]
  "Eb/N0 (AWGN)": f64
  "Comparison and analysis of EVM [%]": f64[][]
types:
  T1 = cluster{"constellation": f64[], "oversampled data": f64[]}
  T2 = enum{"none", "Raised Cosine", "Root Raised Cos", "Gaussian"}
  T3 = cluster{"TX Filter": T2, "Alpha": f64, "filter length": i32}
  T4 = cluster{"M-QAM": enum{"4", "8", "16", "32", "64", "128", "256"}, "Guard Symbols": i32, "Message Symbols": i32, "Samples per Symbol": i32, "Sync Symbols": i32, "PN sequence order": i32, "Symbol Rate [Hz]": f64}
  T5 = cluster{"AWGN": bool, "Phase Noise": bool, "IQ Impairments": bool, "LMS": bool}
  T6 = cluster{"taps per symbol": i32, "delta (training)": f64, "delta (steady state)": f64}
uses:
  NI::G Core::Numeric::Random Number (Range) DBL.gvi
  NI::Modulation::MT Add AWGN.gvi
  NI::Modulation::MT Add Phase Noise.gvi
  NI::Modulation::MT Apply IQ Impairments.gvi
diagram:
  s1 = TRUE  # shift register
  while {
    Property Node(instance in=$"System parameters") -> ("M-QAM"=w1, "Guard Symbols"=w2, "Message Symbols"=w3, "Samples per Symbol"=w4, "Sync Symbols"=w5, "PN sequence order"=w6, "Symbol Rate [Hz]"=w7)
    Property Node(instance in=$"Channel option") -> ("AWGN"=w8, "Phase Noise"=w9, "IQ Impairments"=w10, "LMS"=w11)
    call "sub_Merging Para.gvi"(M-QAM_2=w1, Guard Symbols=w2, Message Symbols=w3, Sync Symbols=w5, PN sequence order=w6) -> (M-QAM=w12, Message=w13)
    call "sub_M-QAM transmitter.gvi"(Symbol Rate[Hz]=w7, M-QAM=w12, System Filter=$"System Filter", Message=w13, # Samples per Symbol=w4, 불리언=s1) -> (output complex waveform=w14, 클러스터 출력=w15)
    call "Random Number (Range) DBL.gvi"(상위 경계=$"Maximum boundary [Eb/N0]", 하위 경계=$"Minimum boundary [Eb/N0]") -> (숫자=w16)
    Property Node(instance in=w15) -> ("# bits per symbol"=w17, "Output Bit Stream"=w18, "QAM System Parameters"=w19)
    case (w8) {
      frame False, Default {
        w20 = w14
        w21 = default
        w22 = 1
      }
      frame True {
        # AWGN
        call "MT Add AWGN.gvi"(reset?=s1, input complex waveform=w14, samples per symbol=w4, bits per symbol=w17, eb/n0=w16) -> (output complex waveform=w20, seed out=w22, error out=w21)
      }
    }
    case (w9) {
      frame False, Default {
        w23 = w21
        w24 = w20
      }
      frame True {
        # Phase noise
        call "MT Add Phase Noise.gvi"(seed in=w22, reset?=s1, input complex waveform=w20, offset frequency=100, noise density=-59, inverse f exponent for noise shape=1, error in=w21) -> (output complex waveform=w24, error out=w23)
      }
    }
    case (w10) {
      frame False, Default {
        w25 = w23
        w26 = w24
      }
      frame True {
        # IQ impairments
        call "MT Apply IQ Impairments.gvi"(frequency offset=0, reset?=s1, input complex waveform=w24, q dc offset=0, iq gain imbalance=0, quadrature skew=1, error in=w23, i dc offset=0, impairment definition="Axis Shear") -> (output complex waveform=w26, error out=w25)
      }
    }
    case (w11) {
      frame False, Default {
        w27 = w26
        w28 = w25
        w29 = w18
        w30 = w19
      }
      frame True {
        # equalizer
        w31 = T6 {"taps per symbol"=8, "delta (training)"=0.01, "delta (steady state)"=0.01}
        call "SUB_LMS-based equalizer.gvi"(feedforward equalizer (lms) parameters=w31, reset?=s1, input complex waveform=w26, QAM system parameters=w19, equalizer length=8, training bits=w18, error in=w25) -> (output complex waveform=w27, output bit stream=w29, error out=w28)
        w30 = w19
      }
    }
    call "sub_Constellation.gvi"(Samples per Symbol=w4, 입력_2=w27, 입력=w26) -> (non filter=w32, adaptive filter=w33)
    $"System filter only applied" <- w32
    $"LMS-based adaptive equalizer" <- w33
    call "sub_EVM_MER.gvi"(입력_3=w27, 입력_4=w29, 입력_5=s1, 입력_6=w26, 입력_2=s1, Output Bit Stream=w18, 입력=w30, error out=w28) -> (EVM History=w34, MER History=w35)
    $"Comparison and analysis of EVM [%]" <- w34
    # [Description]
    #
    # This program was implemented using National Instruments' NI-Modulation toolkit, NI-USRP function.
    #
    # The order of operation is in the order defined by the user, with AWGN, phase noise, IQ impairments, and equalizer.
    #
    # The range of AWGN simulates a wireless communication environment where actual signal attenuation occurs through appropriate random number generation.
    $"Eb/N0 (AWGN)" <- w16
    $"Comparison and analysis of MER [dB]" <- w35
    next s1 = TRUE
    stop if $"정지"
  }
