vi "sub_Merging Para.gvi"   [LabVIEW NXG 5.0.0]
inputs:
  "M-QAM_2": enum{"4", "8", "16", "32", "64", "128", "256"} = "4"
  "Guard Symbols": i32
  "Message Symbols": i32
  "Sync Symbols": i32
  "PN sequence order": i32
outputs:
  "M-QAM": i32
  "Message": T1
types:
  T1 = cluster{"# Guard Bits": i32, "# Sync Bits": i32, "# Message Bits": i32, "PN sequence order": i32}
diagram:
  To Signed 32 Bit Integer(number=$"M-QAM_2") -> w1
  Add(2, w1) -> w2
  Logical Shift(x=1, y=w2) -> w3
  $"M-QAM" <- w3
  Multiply(w2, $"Guard Symbols") -> w4
  Multiply(w2, $"Sync Symbols") -> w5
  Multiply(w2, $"Message Symbols") -> w6
  w7 = T1 {"# Guard Bits"=31, "# Sync Bits"=2048, "# Message Bits"=128, "PN sequence order"=21}
  Property Node(instance in=w7, "# Guard Bits"=w4, "# Sync Bits"=w5, "# Message Bits"=w6, "PN sequence order"=$"PN sequence order") -> (instance out=w8)
  $Message <- w8
