vi "sub_algorithm_1.gvi"   [LabVIEW NXG 5.0.0]
inputs:
  "equalizer taps": i32 = 1
  "equalizer specification": enum{"Specify coefficients", "Specify length"} = "Specify coefficients"
  "input complex waveform": cluster{"t0": f64, "dt": f64, "Y": c128[]} = {"t0"=0, "dt"=1, "Y"=[]}
  "qam system parameters": T1
  "feedforward equalizer (lms) parameters": T2 = {"taps per symbol"=1, "delta (training)"=0.01, "delta (steady state)"=0.01}
  "training symbols": c128[]
  "error in": error
  "reset?": bool = TRUE
outputs:
  "output complex waveform": cluster{"t0": f64, "dt": f64, "Y": c128[]}
  "equalized symbols": c128[]
  "error out": error
panel controls:
  "equalizer coefficients in": c128[]
panel indicators:
  "signal out": c128[]
  "equalizer coefficients out": c128[]
  "lms error": f64[]
types:
  T1 = cluster{"samples per symbol (16)": i32, "symbol map": c128[]}
  T2 = cluster{"taps per symbol": i32, "delta (training)": f64, "delta (steady state)": f64}
uses:
  NI::Modulation::MT Decimate Oversampled Waveform.gvi
diagram:
  case ($"error in") {
    frame No Error {
      Property Node(instance in=$"input complex waveform") -> ("Y"=w6)
      Property Node(instance in=$"qam system parameters") -> ("samples per symbol (16)"=w7, "symbol map"=w8)
      call "sub_gain compen.gvi"(symbols in=w6, symbol map=w8) -> (symbols out=w9, error out=w10)
      Property Node(instance in=$"input complex waveform", "Y"=w9) -> (instance out=w11)
      Is First Call() -> w12
      Logical Or($"reset?", w12) -> w13
      Property Node(instance in=$"feedforward equalizer (lms) parameters") -> ("taps per symbol"=w14)
      Quotient And Remainder(x=w7, y=w14) -> (floor(x/y)=w15)
      call "MT Decimate Oversampled Waveform.gvi"(input complex waveform=w11, decimation factor=w15, error in=w10, reset?=w13) -> (output complex waveform=w16, error out=w17)
      Property Node(instance in=w16) -> ("Y"=w18)
      Multiply($"equalizer taps", w14) -> w19
      Quotient And Remainder(x=w19, y=2) -> (x-y*floor(x/y)=w20)
      Is Equal To 0(x=w20) -> w21
      Boolean To 0 Or 1(Boolean=w21) -> (0, 1=w22)
      Add(w19, w22) -> w23
      call "sub_Update.gvi"(reset?=w13, c(n) in=$"equalizer coefficients in", taps=w23, x=w18, feedforward equalizer {c(n)} parameters=$"feedforward equalizer (lms) parameters", symbol map=w8, training symbols=$"training symbols", error in=w17, equalizer {c(n)}=$"equalizer specification") -> (y=w1, c(n) out=w2, error=w3, error out=w24)
      Array Size(array=w1) -> (size(s)=w25)
      Multiply(w7, w25) -> w26
      Complex Conjugate(x + iy=w2) -> w27
      Quotient And Remainder(x=w7, y=w14) -> (floor(x/y)=w28)
      Array Size(array=w2) -> (size(s)=w29)
      Logical Shift(x=w29, y=-1) -> w30
      Multiply(w30, w28) -> w31
      call "sub_equal wave.gvi"(reset?=w13, equalizer transient=w31, input complex waveform=w11, equalizer taps=w27, oversampling factor=w15, error in=w24) -> (output complex waveform=w32, error out=w33)
      Property Node(instance in=w32) -> ("Y"=w34)
      Initialize Array(element=0+0i, size=0) -> w35
      s1 = uninitialised  # shift register
      while {
        Select(s=w13, t=w35, f=s1) -> w36
        Build Array(w36, w34) -> w37
        Split 1D Array(array=w37, index=w26) -> (first subarray=w38, second subarray=w39)
        next s1 = w39
        continue if FALSE
      }
      Property Node(instance in=w11, "Y"=w38) -> (instance out=w5)
      $"signal out" <- w38
      Merge Errors(w33, w24) -> (error out=w40)
      call "sub_error_clustering.gvi"(final error in=w40, initial error in=$"error in") -> (error out=w4)
    }
    frame Error {
      w1 = default
      w2 = default
      w3 = default
      w4 = $"error in"
      w5 = default
    }
  }
  $"equalized symbols" <- w1
  $"equalizer coefficients out" <- w2
  $"output complex waveform" <- w5
  $"lms error" <- w3
  $"error out" <- w4
