vi "sub_EVM_MER.gvi"   [LabVIEW NXG 5.0.0]
inputs:
  "입력_3": cluster{"t0": f64, "dt": f64, "Y": c128[]}
  "입력_4": i8[]
  "입력_5": bool
  "입력_6": cluster{"t0": f64, "dt": f64, "Y": c128[]}
  "입력_2": bool
  "Output Bit Stream": i8[]
  "입력": "QAM System Parameters.gtype" = {"samples per symbol (16)"=16, "symbol map"=[]}
  "error out": error
outputs:
  "EVM History": f64[][]
  "MER History": f64[][]
types:
  "QAM System Parameters.gtype" = cluster{"samples per symbol (16)": i32, "symbol map": c128[]}
  T1 = cluster{"start index (symbols)": i32, "width (symbols) (-1: all)": i32}
uses:
  NI::Modulation::MT Measure QAM Quadrature Impairments.gvi
diagram:
  w1 = T1 {"start index (symbols)"=65, "width (symbols) (-1: all)"=-1}
  call "MT Measure QAM Quadrature Impairments.gvi"(impairment definition="Axis Shear", reset?=$"입력_5", recovered complex waveform=$"입력_6", input bit stream=$"Output Bit Stream", impairment measurement window=w1, error in=$"error out", QAM system parameters=$"입력") -> (EVM=w2, modulation error ratio=w3)
  w4 = T1 {"start index (symbols)"=65, "width (symbols) (-1: all)"=-1}
  call "MT Measure QAM Quadrature Impairments.gvi"(impairment definition="Axis Shear", reset?=$"입력_2", recovered complex waveform=$"입력_3", input bit stream=$"입력_4", impairment measurement window=w4, QAM system parameters=$"입력") -> (EVM=w5, modulation error ratio=w6)
  # w6: adaptive equalizer
  # w3: system filter only applied
  Build Array(w6, w3) -> w7
  Build Array(w7) -> w8
  $"MER History" <- w8
  Property Node(instance in=w5) -> ("RMS measurement (%)"=w9)
  Property Node(instance in=w2) -> ("RMS measurement (%)"=w10)
  Build Array(w9, w10) -> w11
  Build Array(w11) -> w12
  $"EVM History" <- w12
