vi "sub_M-QAM transmitter.gvi"   [LabVIEW NXG 5.0.0]
inputs:
  "Symbol Rate[Hz]": f64
  "M-QAM": i32
  "System Filter": T2 = {"TX Filter"="Root Raised Cos", "Alpha"=0.5, "filter length"=8}
  "Message": T3 = {"# Guard Bits"=4, "# Sync Bits"=40, "# Message Bits"=1000, "PN sequence order"=9}
  "# Samples per Symbol": i32 = 16
  "error in (no error)": error
  "불리언": bool
outputs:
  "output complex waveform": cluster{"t0": f64, "dt": f64, "Y": c128[]}
  "클러스터 출력": T4
  "출력 스트림": i8[]
types:
  T1 = enum{"none", "Raised Cosine", "Root Raised Cos", "Gaussian"}
  T2 = cluster{"TX Filter": T1, "Alpha": f64, "filter length": i32}
  T3 = cluster{"# Guard Bits": i32, "# Sync Bits": i32, "# Message Bits": i32, "PN sequence order": i32}
  "QAM System Parameters.gtype" = cluster{"samples per symbol (16)": i32, "symbol map": c128[]}
  T4 = cluster{"Output Bit Stream": i8[], "# bits per symbol": i32, "Sync (Bits)": i8[], "Sync (Symbols)": c128[], "pulse shaping filter coefficients": f64[], "matched filter coefficients": f64[], "QAM System Parameters": "QAM System Parameters.gtype"}
uses:
  NI::Modulation::MT Generate Filter Coefficients.gvi
  NI::Modulation::MT Generate QAM System Parameters(M).gvi
  NI::Modulation::MT Generate Bits (Galois, PN Order).gvi
  NI::Modulation::MT Modulate QAM.gvi
diagram:
  Property Node(instance in=$Message) -> ("PN sequence order"=w1, "# Guard Bits"=w2, "# Sync Bits"=w3, "# Message Bits"=w4)
  Is First Call() -> w5
  Logical Or(TRUE, w5) -> w6
  Is First Call() -> w7
  Logical Or(w6, w7) -> w8
  Logical And(w8, $"불리언") -> w9
  Property Node(instance in=$"System Filter") -> ("TX Filter"=w10, "Alpha"=w11, "filter length"=w12)
  To Unsigned 64 Bit Integer(number="QAM") -> w13
  call "MT Generate Filter Coefficients.gvi"(filter length=w12, pulse shaping filter=w10, pulse shaping samples per symbol=$"# Samples per Symbol", matched samples per symbol=$"# Samples per Symbol", filter parameter=w11, error in=$"error in (no error)", modulation type=w13) -> (pulse shaping filter coefficients=w14, matched filter coefficients=w15, error out=w16)
  call "MT Generate QAM System Parameters(M).gvi"(samples per symbol=$"# Samples per Symbol", M-QAM=$"M-QAM", error in=w16) -> (QAM system parameters=w17, bits per symbol=w18, error out=w19)
  call "MT Generate Bits (Galois, PN Order).gvi"(reset?=w8, total bits=w4, PN sequence order=w1, seed in=-692093454, error in=w19) -> (output bit stream=w20, error out=w21)
  call "sub_Convert bit to array.gvi"(가드 비트=w2, 싱크 비트 입력=w3, 출력 비트 스트림=w20, 논리적 AND=w9, 에러=w21) -> (입력=w22, 싱크 비트=w23, 에러 출력=w24)
  Is First Call() -> w25
  Logical Or(w25, w8) -> w26
  call "sub_FIFO of bit.gvi"(블록 길이 (-1)=-1, 입력=w22, 논리적 OR=w26) -> (배열=w27, 입력 스트림=w28)
  Array Size(array=w27)
  $"출력 스트림" <- w28
  Property Node(instance in=w17) -> ("symbol map"=w29)
  call "sub_M-QAM mapper.gvi"(reset?=w6, input bit stream=w23, error in=w24, symbol map=w29) -> (symbols=w30, error out=w31)
  Property Node(instance in=T4 {all zero or empty}, "Output Bit Stream"=w28, "Sync (Bits)"=w23, "Sync (Symbols)"=w30, "pulse shaping filter coefficients"=w14, "matched filter coefficients"=w15, "QAM System Parameters"=w17, "# bits per symbol"=w18) -> (instance out=w32)
  $"클러스터 출력" <- w32
  call "MT Modulate QAM.gvi"(reset?=w6, input bit stream=w28, QAM system parameters=w17, symbol rate=$"Symbol Rate[Hz]", pulse shaping filter coefficients=w14, error in=w31) -> (output complex waveform=w33)
  $"output complex waveform" <- w33
