vi "sub_Update.gvi"   [LabVIEW NXG 5.0.0]
inputs:
  "x": c128[]
  "error in": error
  "equalizer {c(n)}": enum{"Specify coefficients", "Specify length"} = "Specify coefficients"
  "feedforward equalizer {c(n)} parameters": T1 = {"taps per symbol"=1, "delta (training)"=0.01, "delta (steady state)"=0.01}
  "symbol map": c128[]
  "training symbols": c128[]
  "taps": i32 = 1
  "reset?": bool = TRUE
  "c(n) in": c128[]
outputs:
  "y": c128[]
  "error out": error
  "error": f64[]
  "c(n) out": c128[]
panel controls:
  "error in_2": error
panel indicators:
  "error out_2": error
types:
  T1 = cluster{"taps per symbol": i32, "delta (training)": f64, "delta (steady state)": f64}
uses:
  NI::Modulation::mod_Symbol Hard Decision.gvi
diagram:
  $"error out" <- $"error in"
  case ($"error in") {
    frame No Error {
      s1 = uninitialised  # shift register
      s2 = uninitialised  # shift register
      while {
        Is First Call() -> w4
        Logical Or($"reset?", w4) -> w5
        case (w5) {
          frame False, Default {
            Insert Into Array(inArray=$x, index0=0, new=s2) -> w6
            w7 = s1
          }
          frame True {
            case ($"equalizer {c(n)}") {
              frame "Specify coefficients", Default {
                w7 = $"c(n) in"
              }
              frame "Specify length" {
                Quotient And Remainder(x=$taps, y=2) -> (x-y*floor(x/y)=w8)
                Is Equal To 0(x=w8) -> w9
                Boolean To 0 Or 1(Boolean=w9) -> (0, 1=w10)
                Add($taps, w10) -> w11
                Quotient And Remainder(x=w11, y=2) -> (floor(x/y)=w12)
                Initialize Array(element=0+0i, size=w12) -> w13
                Build Array(w13, 1+0i, w13) -> w7
              }
            }
            Array Size(array=w7) -> (size(s)=w14)
            Quotient And Remainder(x=w14, y=2) -> (floor(x/y)=w15)
            Initialize Array(element=0+0i, size=w15) -> w16
            Insert Into Array(inArray=$x, index0=0, new=w16) -> w6
          }
        }
        Property Node(instance in=$"feedforward equalizer {c(n)} parameters") -> ("taps per symbol"=w17, "delta (training)"=w18, "delta (steady state)"=w19)
        Array Size(array=w6) -> (size(s)=w20)
        Array Size(array=w7) -> (size(s)=w21)
        Subtract(x=w20, y=w21) -> w22
        Quotient And Remainder(x=w22, y=w17) -> (floor(x/y)=w23)
        Multiply(w17, w23) -> w24
        Array Subset(array=w6, index0=w24) -> w25
        Select(s=w5, t=2, f=1) -> w26
        Array Size(array=$"training symbols") -> (size(s)=w27)
        To Double Precision Complex(number=w18) -> w28
        To Double Precision Complex(number=w19) -> w29
        s3 = w7  # shift register
        for (N = w26) {
          s4 = s3  # shift register
          for (N = w23) (iteration -> i1) {
            $"error out_2" <- $"error in_2"
            Multiply(w17, i1) -> w30
            Array Subset(array=w6, index0=w30, length0=w21) -> w31
            Reverse 1D Array(array=w31) -> (reversed array=w32)
            Is Less(x=i1, y=w27) -> w33
            Logical And(w33, w5) -> w34
            Complex Conjugate(x + iy=s4) -> w35
            Reverse 1D Array(array=w31) -> (reversed array=w36)
            Multiply(w36, w35) -> w37
            Add Array Elements(numeric array=w37) -> (sum=w38)
            case (w34) {
              frame False, Default {
                call "mod_Symbol Hard Decision.gvi"(symbol in=w38, symbol map=$"symbol map") -> (symbol out=w39)
                w40 = w29
              }
              frame True {
                Array Index(array=$"training symbols") -> (out0[i1]=w39)
                w40 = w28
              }
            }
            Subtract(x=w38, y=w39) -> w41
            Complex Conjugate(x + iy=w41) -> w42
            Multiply(w40, w32, w42) -> w43
            Subtract(x=s4, y=w43) -> w44
            Complex To Polar(r * e^(i*theta)=w42) -> (r=w45)
            Multiply(w45, w45) -> w46
            append w38 to w1
            append w46 to w3
            next s4 = w44
          }
          next s3 = s4
        }
        next s1 = s3
        next s2 = w25
        stop if TRUE
      }
      w2 = s1
    }
    frame Error {
      w1 = default
      w2 = default
      w3 = default
    }
  }
  $y <- w1
  $"c(n) out" <- w2
  $error <- w3
