vi "sub_equal wave.gvi"   [LabVIEW NXG 5.0.0]
inputs:
  "input complex waveform": cluster{"t0": f64, "dt": f64, "Y": c128[]}
  "equalizer taps": c128[]
  "oversampling factor": i32
  "error in": error
  "reset?": bool = TRUE
  "equalizer transient": i32
outputs:
  "error out": error
  "output complex waveform": cluster{"t0": f64, "dt": f64, "Y": c128[]}
uses:
  NI::Analysis::SML::ma_sml_Interpolation by Zero Insert (complex input).gvi
diagram:
  case ($"error in") {
    frame No Error {
      Is First Call() -> w3
      Logical Or($"reset?", w3) -> w4
      call "ma_sml_Interpolation by Zero Insert (complex input).gvi"(x=$"equalizer taps", L=$"oversampling factor") -> (y=w5)
      call "sub_apply filter.gvi"(reset?=w4, input complex waveform=$"input complex waveform", filter coefficients=w5, error in=$"error in") -> (output complex waveform=w6, error out=w1)
      case (w4) {
        frame False, Default {
          w2 = w6
        }
        frame True {
          Property Node(instance in=w6) -> ("Y"=w7)
          Array Subset(array=w7, index0=$"equalizer transient") -> w8
          Property Node(instance in=w6, "Y"=w8) -> (instance out=w2)
        }
      }
    }
    frame Error {
      w1 = $"error in"
      w2 = default
    }
  }
  $"output complex waveform" <- w2
  $"error out" <- w1
