vi "sub_gain compen.gvi"   [LabVIEW NXG 5.0.0]
inputs:
  "error in": error
  "symbols in": c128[]
  "symbol map": c128[]
outputs:
  "symbols out": c128[]
  "error out": error
diagram:
  case ($"error in") {
    frame No Error {
      Array Size(array=$"symbol map") -> (size(s)=w3)
      Absolute Value(x=$"symbol map") -> w4
      Multiply(w4, w4) -> w5
      Add Array Elements(numeric array=w5) -> (sum=w6)
      Divide(x=w6, y=w3) -> w7
      Array Size(array=$"symbols in") -> (size(s)=w8)
      Absolute Value(x=$"symbols in") -> w9
      Multiply(w9, w9) -> w10
      Add Array Elements(numeric array=w10) -> (sum=w11)
      Divide(x=w11, y=w8) -> w12
      Divide(x=w7, y=w12) -> w13
      Square Root(x=w13) -> w14
      Multiply($"symbols in", w14) -> w1
      w2 = $"error in"
    }
    frame Error {
      w1 = default
      w2 = $"error in"
    }
  }
  $"error out" <- w2
  $"symbols out" <- w1
